# Dynamo graph automation.dyn (Dynamo 2.19.3.6394)

select_model_element = DSModelElementSelection()  # 1 picked in the model
geometry = Element.Geometry(element=select_model_element)
code_block = CodeBlock { i = 16; j = (i / 2) - 1; 2; 1; -1; }
pointsAtEqualSegmentLength = Curve.PointsAtEqualSegmentLength(curve=geometry, divisions=code_block.i)
flatten = List.Flatten(list=pointsAtEqualSegmentLength)
code_block_2 = CodeBlock { 0..2; }
number = DoubleInput(2)
sublists = List.Sublists(list=flatten, ranges=code_block_2, offset=number)
floor = Math.Floor(number=code_block.j)
removeItemAtIndex = List.RemoveItemAtIndex(list=sublists, indices=floor)
family_types = FamilyTypes("bridge element:bridge element")
byPoints = AdaptiveComponent.ByPoints(points=removeItemAtIndex, familyType=family_types)
string = StringInput("depth")
dropEveryNthItem = List.DropEveryNthItem(list=flatten, n=code_block.out2, offset=code_block.out3)
Z = Point.Z(point=dropEveryNthItem)
mul = Z * code_block.out4
setParameterByName = Element.SetParameterByName(element=byPoints, parameterName=string, value=mul)
